# Grasshopper definition curved-persian-wall-mm.ghx (Grasshopper 1.0.8)
# Hezarbaaf example: curved wall, one door and two windows under panj-o-haft arches, diamond relief in two tones. Units: millimetres.

pt = Point([Point(0, 0, 0), Point(2200, 800, 0), Point(4400, 0, 0), Point(6600, -800, 0), Point(8800, 0, 0)])
intcrv = Interpolate(Vertices=pt, Degree=3, Periodic=False, KnotStyle=0)  # -> Curve, Length, Domain
bwall = BrickWall(Curve=intcrv.Curve, Height=Slider(3400, range=2000..5000), Format="Iranian 20x10x5", Bond="Stretcher")  # -> Bricks, Planes, Course, Cut, Report, Wall
panel = Panel("""1200 To 2200
3800 To 5000
6600 To 7600""")
panel_2 = Panel("""900 To 1800
0 To 2000
900 To 1800""")
arch = ArchedOpenings(Curve=intcrv.Curve, Wall=bwall.Wall, Along=panel, Height=panel_2, Kind=4, Ring=1, Rings=1, Shape=50)  # -> Mesh, Arches, Wall, Report
fwave = FieldWaveموج(Angle=45, Wavelength=700, Phase=0)
fwave_2 = FieldWaveموج(Angle=-45, Wavelength=700, Phase=0)
fmix = FieldCombineترکیبمیدان(A=fwave, B=fwave_2, Mode=1, Invert=False, Contrast=1)
panel_3 = Panel(arch.Report)
bop = BrickOperationعملیاتآجر(Wall=arch.Wall, Field=fmix, Mode=1, Amount=20, Steps=2)  # -> Wall, Variants
tones = BrickTones(Wall=bop.Wall, Field=fmix, Tones=2, Dither=False)  # -> Wall, Meshes, Colours, Counts, Tone
bout = BrickOutputخروجیآجر(Wall=tones.Wall, Colour=1, Mortar=2)  # -> Bricks, Mesh, Problems, Warnings, Report, Legend, Mortar
panel_4 = Panel(bout.Report)
