# Grasshopper definition curved-persian-wall.ghx (Grasshopper 1.0.8)
# Hezarbaaf example: curved wall, one door and two windows under panj-o-haft arches, diamond relief in two tones. Units: metres.

pt = Point([Point(0, 0, 0), Point(2.2, 0.8, 0), Point(4.4, 0, 0), Point(6.6, -0.8, 0), Point(8.8, 0, 0)])
intcrv = Interpolate(Vertices=pt, Degree=3, Periodic=False, KnotStyle=0)  # -> Curve, Length, Domain
bwall = BrickWall(Curve=intcrv.Curve, Height=Slider(3.4, range=2..5), Format="Iranian 20x10x5", Bond="Stretcher")  # -> Bricks, Planes, Course, Cut, Report, Wall
panel = Panel("""1.2 To 2.2
3.8 To 5.0
6.6 To 7.6""")
panel_2 = Panel("""0.9 To 1.8
0 To 2.0
0.9 To 1.8""")
arch = ArchedOpenings(Curve=intcrv.Curve, Wall=bwall.Wall, Along=panel, Height=panel_2, Kind=4, Ring=1, Rings=1, Shape=50)  # -> Mesh, Arches, Wall, Report
fwave = FieldWaveموج(Angle=45, Wavelength=0.7, Phase=0)
fwave_2 = FieldWaveموج(Angle=-45, Wavelength=0.7, Phase=0)
fmix = FieldCombineترکیبمیدان(A=fwave, B=fwave_2, Mode=1, Invert=False, Contrast=1)
panel_3 = Panel(arch.Report)
bop = BrickOperationعملیاتآجر(Wall=arch.Wall, Field=fmix, Mode=1, Amount=0.02, Steps=2)  # -> Wall, Variants
tones = BrickTones(Wall=bop.Wall, Field=fmix, Tones=2, Dither=False)  # -> Wall, Meshes, Colours, Counts, Tone
bout = BrickOutputخروجیآجر(Wall=tones.Wall, Colour=1, Mortar=2)  # -> Bricks, Mesh, Problems, Warnings, Report, Legend, Mortar
panel_4 = Panel(bout.Report)
