# Grasshopper definition hezarbaaf-test-3.ghx (Grasshopper 1.0.8)
# Hezarbaaf test: slider + panel into Tower, then Brick Output

tower = Tower(Centre=Point(0, 0, 0), Radius=1.5, TopRadius=1, Height=Slider(5, range=1..10), Format="Waal (NL)", Bond="Stretcher")  # -> Mesh, Wall, Report
bout = BrickOutputخروجیآجر(Wall=tower.Wall, Colour=0)  # -> Bricks, Mesh, Problems, Warnings, Report, Legend
