# Grasshopper definition house-of-40-knots-study.ghx (Grasshopper 1.0.8)
# House of 40 Knots (Madjdabadi + Mashhadimirza, Tehran 2014): a study after the published drawings. Rod screens with knot patterns. Units: metres.

pt = Point([Point(0, -0.1, 18.55), Point(5.3535, -0.1, 18.55), Point(10.707, -0.1, 18.55)])
pt_2 = Point([Point(0, 0, 15.35), Point(5.4429, -0.1526, 15.35), Point(10.8859, -0.3052, 15.35)])
pt_3 = Point([Point(0, -0.25, 12.15), Point(5.3314, -0.1503, 12.15), Point(10.6628, -0.0507, 12.15)])
pt_4 = Point([Point(0, 0, 8.95), Point(5.465, -0.1787, 8.95), Point(10.93, -0.3575, 8.95)])
pt_5 = Point([Point(0, -0.3, 5.75), Point(5.31, -0.1511, 5.75), Point(10.62, -0.0022, 5.75)])
pt_6 = Point([Point(0, 0, 2.55), Point(5.4204, -0.1267, 2.55), Point(10.8409, -0.2533, 2.55)])
pt_7 = Point([Point(0, 0, 0.15), Point(5.31, 0, 0.15), Point(10.62, 0, 0.15)])
# HOUSE OF 40 KNOTS · خانهٔ چهل‌گره
# Habibeh Madjdabadi + Alireza Mashhadimirza, Tehran, 2014
# 
# A study after the published drawings and photos, to show how such a façade is set up.
# All credit for the design belongs to its architects. Dimensions, hill profiles, window bays and the
# place of each raised brick are estimated by eye, not taken from their files.
# 
# Each row below is one band of one façade:  curve → Rod Screen (Knots on) → Knot Pattern → Brick Output.
# Edit the text in a pattern panel:   .  hollow     #  filler     o  raised   (top course first, one character per rod).
# Units: metres.
intcrv = Interpolate(Vertices=pt, Degree=3, Periodic=False, KnotStyle=0)  # -> Curve, Length, Domain
intcrv_2 = Interpolate(Vertices=pt_2, Degree=3, Periodic=False, KnotStyle=0)  # -> Curve, Length, Domain
intcrv_3 = Interpolate(Vertices=pt_3, Degree=3, Periodic=False, KnotStyle=0)  # -> Curve, Length, Domain
intcrv_4 = Interpolate(Vertices=pt_4, Degree=3, Periodic=False, KnotStyle=0)  # -> Curve, Length, Domain
intcrv_5 = Interpolate(Vertices=pt_5, Degree=3, Periodic=False, KnotStyle=0)  # -> Curve, Length, Domain
intcrv_6 = Interpolate(Vertices=pt_6, Degree=3, Periodic=False, KnotStyle=0)  # -> Curve, Length, Domain
intcrv_7 = Interpolate(Vertices=pt_7, Degree=3, Periodic=False, KnotStyle=0)  # -> Curve, Length, Domain
rods = RodScreen(Curve=intcrv.Curve, Height=1.5, Format="Iranian 20x10x5", Gap=5, Holes=1, Spacing=110, Rod=12, Knots=True)  # -> Wall, Rods, RodPipes, Report
rods_2 = RodScreen(Curve=intcrv_2.Curve, Height=2.85, Format="Iranian 20x10x5", Gap=5, Holes=1, Spacing=110, Rod=12, Knots=True)  # -> Wall, Rods, RodPipes, Report
rods_3 = RodScreen(Curve=intcrv_3.Curve, Height=2.85, Format="Iranian 20x10x5", Gap=5, Holes=1, Spacing=110, Rod=12, Knots=True)  # -> Wall, Rods, RodPipes, Report
rods_4 = RodScreen(Curve=intcrv_4.Curve, Height=2.85, Format="Iranian 20x10x5", Gap=5, Holes=1, Spacing=110, Rod=12, Knots=True)  # -> Wall, Rods, RodPipes, Report
rods_5 = RodScreen(Curve=intcrv_5.Curve, Height=2.85, Format="Iranian 20x10x5", Gap=5, Holes=1, Spacing=110, Rod=12, Knots=True)  # -> Wall, Rods, RodPipes, Report
rods_6 = RodScreen(Curve=intcrv_6.Curve, Height=2.85, Format="Iranian 20x10x5", Gap=5, Holes=1, Spacing=110, Rod=12, Knots=True)  # -> Wall, Rods, RodPipes, Report
rods_7 = RodScreen(Curve=intcrv_7.Curve, Height=2.35, Format="Iranian 20x10x5", Gap=5, Holes=1, Spacing=110, Rod=12, Knots=True)  # -> Wall, Rods, RodPipes, Report
panel = Panel("""#####o#.#o#o#o#o###################o#o#o#.#o###o#########o#####o#o##
##.###.###o###o#o#########.#####o#o#.#.#o###o###########o###o###o###
###o#o###o#o###.#o#################o#o#.#o#o#####o#########o###o####
####o###.#o#o#o#####.#o#.#o#######o#########.#o#o#####o#o#######o###
###############o###o#######o###o#########o#o#o#o#.#######o#######o##
####o#####o#.#o#################o###.#####o###.#.#######o###o#######
###o###o#o#################o#########o#o###.###########o#####.###.##
##########o#################o#####o#o###.###o#o#o#.#####o###o#.#####
#######o#o#o#o#######o#####o#o#####o#o#o###o###o#o#####o#o#o#o###.##
####.#####o#o#####.###.#####o#.###o#######o###o#o#######.###########
###o#o#o#o#o#########o#o#o#o#o#######o#o#o###o#o#o#o###o#o#o#o###o##
########o#################o#o###########o#o#o###o#####o###o#########
###o#########o#############o###o#####o#o###o#o#o#######o#o#o#o#o#o##
##o#######################o#o###o#############o#####o#o#o#o#o#######
###o#####o#########o###.#############o#o###o#o#o#########o#####o####
##o#o#o#.#o#o#o#########o#####o#o#####o###o###o#o#####o#.#o#########
###o#######.#######o#########o###o#######.#####o#####.#o#o###o######
##o#o#o#########o#o#####o#o#o###########o#####o#o###o#o###o###o#####
###o#######o###o#############o#.#o#o#.#o#o#####o#o#.#o#o#o#o#o######
##o#####o#o#####o#o#o###o#################o#o#o###.#o###o#o#.#o#####
#####.#####.###o#######o###o#o#######o#o#.#o#############o#o#o######
##o#o#######################.###########.#o#o###########o#o#o#o#####
#####o#####.#####o#o###o#########o###o#o#.#######o#######o#######.##
######o#####o#######o###########o#############.#######.#.#o#o#.#o###
###o#####o###o###o#.#.#######.#o###o#######o#o#o#####o#o###o#o######
######.#########o#########o#####o#o#o#o###o###o#######o###o###o#.###
#######.#########o#o#########o#o#o###o#o#o#o#o#o#######o#o###.######""")
panel_2 = Panel(""".....................................................................
.....................................................................
.....................................................................
...............#.#...................................................
..............#.#.#..................................................
...............#.#.#.................................................
..............#.#.#.#####............................................
.............#.#.#.#.#o###...........................................
..........#.#.#.#.#.#o#####..........................................
.........#.#.#.#.#.#.###o#o#.#.#.....................................
........#.#.#.#.#.#.#o#o#o#.#.#.#....................................
.......#.#.#.#.#.#.#.#o###.#.#.#.#...................................
......#.#.#.#.#.#.#.#######.#.#.#.#.#.#.##...........................
..####.#.#.#.#.#.#.#.###o#o#.#.#.#.#.#.#.###.........................
.####.#.#.#.#.#.#.#.#######.#.#.#.#.#.#.######.......................
##o#.#.#.#.#.#.#.#.#.#o###o#.#.#.#.#.#.#.#####.#.#.#.#...............
#####.#.#.#.#.#.#.#.#o#####.#.#.#.#.#.#.#######.#.#.#.#..............
######.#.#.#.#.#.#.#.###.###.#.#.#.#.#.#.#o###.#.#.#.#.#.#.#.#.#####.
#####.#.#.#.#.#.#.#.#######.#.#.#.#.#.#.###o###.#.#.#.#.#.#.#.#.#####
##.###.#.#.#.#.#.#.#.#######.#.#.#.#.#.#.#o#o#.#.#.#.#.#.#.#.#.######
#####.#.#.#.#.#.#.#.#######.#.#.#.#.#.#.#o###o#.#.#.#.#.#.#.#.#.#####
######.#.#.#.#.#.#.#.#####o#.#.#.#.#.#.#.#####.#.#.#.#.#.#.#.#.###o##
#####.#.#.#.#.#.#.#.#######.#.#.#.#.#.#.#######.#.#.#.#.#.#.#.#.#o###
##o###.#.#.#.#.#.#.#.#######.#.#.#.#.#.#.#o###.#.#.#.#.#.#.#.#.#o#o##
###o#.#.#.#.#.#.#.#.#####o#.#.#.#.#.#.#.#o###o#.#.#.#.#.#.#.#.#.#o###
####o#.#.#.#.#.#.#.#.#####o#.#.#.#.#.#.#.#o###.#.#.#.#.#.#.#.#.######
###.#.#.#.#.#.#.#.#.#######.#.#.#.#.#.#.#o#o#o#.#.#.#.#.#.#.#.#.#o###
##o###.#.#.#.#.#.#.#.#####o#.#.#.#.#.#.#.#o#o#.#.#.#.#.#.#.#.#.###o##
#####.#.#.#.#.#.#.#.#o#####.#.#.#.#.#.#.#o#o#o#.#.#.#.#.#.#.#.#.#o###
####.#.#.#.#.#.#.#.#.###o###.#.#.#.#.#.#.#o#o#.#.#.#.#.#.#.#.#.######
###o#.#.#.#.#.#.#.#.#######.#.#.#.#.#.#.#####o#.#.#.#.#.#.#.#.#.#o###
####o#.#.#.#.#.#.#.#.#o#o###.#.#.#.#.#.#.#o#o#.#.#.#.#.#.#.#.#.###o##
#####.#.#.#.#.#.#.#.#o###o#.#.#.#.#.#.#.#o#o#o#.#.#.#.#.#.#.#.#.#o###
##.###.#.#.#.#.#.#.#.#####o#.#.#.#.#.#.#.#####.#.#.#.#.#.#.#.#.###o##
#####.#.#.#.#.#.#.#.#o#o#o#.#.#.#.#.#.#.#o###.#.#.#.#.#.#.#.#.#.#o###
####o#.#.#.#.#.#.#.#.###o#o#.#.#.#.#.#.#.#o#o#.#.#.#.#.#.#.#.#.######
###o#.#.#.#.#.#.#.#.#o#.#o#.#.#.#.#.#.#.###o#o#.#.#.#.#.#.#.#.#.#####
##o#o#.#.#.#.#.#.#.#.###o#o#.#.#.#.#.#.#.###.#.#.#.#.#.#.#.#.#.######
#####.#.#.#.#.#.#.#.###o#o#.#.#.#.#.#.#.#####o#.#.#.#.#.#.#.#.#.#####
##o#o#.#.#.#.#.#.#.#.#o#####.#.#.#.#.#.#.#####.#.#.#.#.#.#.#.#.######
###o#o#o###o#######.#o#o#.###########o#####o#o###o#o#o#####o#####.###
######o#o###################o#o#######o#o#o###o###.#o#o#######.######
###o#o#o#######.#####o###########o#####o#####o#.#o#o#########.#######
####o#o#o#o###########o#######o#o#######.###########o#o###.#####o####
#######o###o#############o#o#o###o###################o#.#.###########
####.#o###o#############o###o###o###########o#o###o###o#######o######
###o#.###o#########.#o###o#o#o#.#o#.###########o#.#o#o#########o#o###
##o#####o#############o###o#o#o#####o#o###########o#####o###o########
#######.#o#o#.#####o#o#o###.#######o#o#####o###o###o#o###o#o#.#.#####
##o#o#o#o#####o#o#######o###o#############.#########o#.#o#####o######
###o#o#######o#############o###o#################o#####o#o###o#o#o###""")
panel_3 = Panel("""....................................................................
....................................................................
............................#.#.....................................
..........................o#.#.#.#..................................
........................###.#.#.#.#.................................
......................o###o#.#.#.#.#................................
....................#.###.#.#.#.#.#.#...............................
...................#.#####o#.#.#.#.#.#.#............................
..................#.#.#o###.#.#.#.#.#.#.##..........................
...............#.#.#.#o#####.#.#.#.#.#.#.#o#........................
............#.#.#.#.#.###o#.#.#.#.#.#.#.#####.......................
...........#.#.#.#.#.###o#o#.#.#.#.#.#.#.#o#o#......................
..........#.#.#.#.#.#.#####.#.#.#.#.#.#.#####o#.#...................
.........#.#.#.#.#.#.#o#o###.#.#.#.#.#.#.#####.#.#.#................
......#.#.#.#.#.#.#.#.#o###.#.#.#.#.#.#.#####o#.#.#.#.#.#...........
..o#o#.#.#.#.#.#.#.#.#.#o#o#.#.#.#.#.#.#.#####.#.#.#.#.#.#..........
.####.#.#.#.#.#.#.#.#.#####.#.#.#.#.#.#.###.###.#.#.#.#.#.#.#.......
##o#.#.#.#.#.#.#.#.#.#####.#.#.#.#.#.#.#.#####.#.#.#.#.#.#.#.#.#####
#####.#.#.#.#.#.#.#.#.#####.#.#.#.#.#.#.#o#####.#.#.#.#.#.#.#.#.####
##o###.#.#.#.#.#.#.#.#####o#.#.#.#.#.#.#.#####.#.#.#.#.#.#.#.#.#####
###.#.#.#.#.#.#.#.#.#.#.###.#.#.#.#.#.#.#######.#.#.#.#.#.#.#.#.#o##
######.#.#.#.#.#.#.#.#o###o#.#.#.#.#.#.#.#####.#.#.#.#.#.#.#.#.#o###
#####.#.#.#.#.#.#.#.#.###o#.#.#.#.#.#.#.#.###.#.#.#.#.#.#.#.#.#.####
####o#.#.#.#.#.#.#.#.#####o#.#.#.#.#.#.#.#####.#.#.#.#.#.#.#.#.#####
#####.#.#.#.#.#.#.#.#.#####.#.#.#.#.#.#.#######.#.#.#.#.#.#.#.#.####
##o#o#.#.#.#.#.#.#.#.#####o#.#.#.#.#.#.#.#####.#.#.#.#.#.#.#.#.#o###
#####.#.#.#.#.#.#.#.#.#####.#.#.#.#.#.#.#o###o#.#.#.#.#.#.#.#.#.####
####o#.#.#.#.#.#.#.#.#######.#.#.#.#.#.#.#o###.#.#.#.#.#.#.#.#.#####
###o#.#.#.#.#.#.#.#.#.###o#.#.#.#.#.#.#.#o#####.#.#.#.#.#.#.#.#.####
####o#.#.#.#.#.#.#.#.#####o#.#.#.#.#.#.#.#####.#.#.#.#.#.#.#.#.#####
#####.#.#.#.#.#.#.#.#.#o###.#.#.#.#.#.#.###o#o#.#.#.#.#.#.#.#.#.####
####o#.#.#.#.#.#.#.#.#####.#.#.#.#.#.#.#.###o#.#.#.#.#.#.#.#.#.#####
#####.#.#.#.#.#.#.#.#.#.###.#.#.#.#.#.#.#######.#.#.#.#.#.#.#.#.####
######.#.#.#.#.#.#.#.#####o#.#.#.#.#.#.#.#o###.#.#.#.#.#.#.#.#.#####
###o#.#.#.#.#.#.#.#.#.#####.#.#.#.#.#.#.#o#o#o#.#.#.#.#.#.#.#.#.####
######.#.#.#.#.#.#.#.#o#.###.#.#.#.#.#.#.#o###.#.#.#.#.#.#.#.#.#.###
#####.#.#.#.#.#.#.#.#.#####.#.#.#.#.#.#.#o#o###.#.#.#.#.#.#.#.#.####
##o#o#.#.#.#.#.#.#.#.#######.#.#.#.#.#.#.###o#.#.#.#.#.#.#.#.#.#####
#####.#.#.#.#.#.#.#.#.#o#o#.#.#.#.#.#.#.#.###o#.#.#.#.#.#.#.#.#.####
####o#.#.#.#.#.#.#.#.#####o#.#.#.#.#.#.#.#####.#.#.#.#.#.#.#.#.#####
###o###o#######o###o#.#######o#######.#####.#o#o#o#######o##########
######o#o#.#o#o###o###o###o#o###o#######o###o#o#o#o#o#o###o#.###o###
###o#########o###.###o###o#o#o#######o#####.#o#####o#.###o##########
##o#o#.#############o#o#o###########.###.#o###o#o#######o###o#o#####
###o###o###############o#####o###o#o###o#.#o#o###o#######o#.#.######
##########o#o#####.###o###o#o#o#######.#.###o###########o#o#o#o#o###
###o#####o###o#######.###.###o#####o#o#####.#o#o#.#o#o#o###o#o######
####o#o###########o###.###.#o###o#o#########o#o#.#o#o#########o#####
###################o#o#o#####o#o#o###o#######o#o#######o#o#.#.#o#o##
##o###o#######o#o#o#o###o#o#o#o#o#####################.#o#####o#####
###o###o#o#####o#.#o#o#o#.#o#o#########o###o#########o#######o#o#o##""")
panel_4 = Panel("""......................................................................
......................................................................
..........................................#...........................
.........................................#o###........................
........................................#o#####.......................
.......................................#.#o###.#.#.#..................
......................................#.#o###o#.#.#.#.................
.....................................#.#.#.###.#.#.#.#.#..............
..................................#.#.#.#o#o#o#.#.#.#.#.#.............
.................................#.#.#.#.#o###.#.#.#.#.#.#............
............................#.#.#.#.#.#.#o###o#.#.#.#.#.#.#...........
...........................#.#.#.#.#.#.#.###o#.#.#.#.#.#.#.#.#........
.........................o#.#.#.#.#.#.#.#.#####.#.#.#.#.#.#.#.#.......
.......................###o#.#.#.#.#.#.#.#o###.#.#.#.#.#.#.#.#.##.....
..................#.#.#o#o#.#.#.#.#.#.#.#####o#.#.#.#.#.#.#.#.#.#.....
...............#.#.#.#o#o#o#.#.#.#.#.#.#.#o###.#.#.#.#.#.#.#.#.#####..
..........#.#.#.#.#.#.###o#.#.#.#.#.#.#.#######.#.#.#.#.#.#.#.#.#####.
.......#.#.#.#.#.#.#.#######.#.#.#.#.#.#.#####.#.#.#.#.#.#.#.#.#o#####
#####.#.#.#.#.#.#.#.#.#o#o#.#.#.#.#.#.#.#####o#.#.#.#.#.#.#.#.#.#.####
##o#o#.#.#.#.#.#.#.#.#####.#.#.#.#.#.#.#.#####.#.#.#.#.#.#.#.#.#.#####
###o#.#.#.#.#.#.#.#.#.###o#.#.#.#.#.#.#.#######.#.#.#.#.#.#.#.#.######
##o#.#.#.#.#.#.#.#.#.#o###o#.#.#.#.#.#.#.#.###.#.#.#.#.#.#.#.#.#######
#####.#.#.#.#.#.#.#.#.###.#.#.#.#.#.#.#.#######.#.#.#.#.#.#.#.#.######
##o#.#.#.#.#.#.#.#.#.#o###o#.#.#.#.#.#.#.#.###.#.#.#.#.#.#.#.#.#o#o###
###o#.#.#.#.#.#.#.#.#.###o#.#.#.#.#.#.#.###o###.#.#.#.#.#.#.#.#.###.##
##o#o#.#.#.#.#.#.#.#.###o###.#.#.#.#.#.#.###o#.#.#.#.#.#.#.#.#.#o#####
###o#.#.#.#.#.#.#.#.#.#####.#.#.#.#.#.#.#######.#.#.#.#.#.#.#.#.#.#o##
######.#.#.#.#.#.#.#.#o#o###.#.#.#.#.#.#.#####.#.#.#.#.#.#.#.#.#o#####
#####.#.#.#.#.#.#.#.#.###o#.#.#.#.#.#.#.#o#o###.#.#.#.#.#.#.#.#.###o##
##o#.#.#.#.#.#.#.#.#.#####o#.#.#.#.#.#.#.#o###.#.#.#.#.#.#.#.#.#######
###o#.#.#.#.#.#.#.#.#.#o#.#.#.#.#.#.#.#.#######.#.#.#.#.#.#.#.#.######
##o###.#.#.#.#.#.#.#.###o#o#.#.#.#.#.#.#.#o#o#.#.#.#.#.#.#.#.#.#o#####
#####.#.#.#.#.#.#.#.#.###.#.#.#.#.#.#.#.#o#####.#.#.#.#.#.#.#.#.######
####o#.#.#.#.#.#.#.#.#.###o#.#.#.#.#.#.#.#o#o#.#.#.#.#.#.#.#.#.#o#o###
###o#.#.#.#.#.#.#.#.#.#o###.#.#.#.#.#.#.#o#o#.#.#.#.#.#.#.#.#.#.#o#o##
######.#.#.#.#.#.#.#.#o#####.#.#.#.#.#.#.###.#.#.#.#.#.#.#.#.#.#o#####
#####.#.#.#.#.#.#.#.#.#####.#.#.#.#.#.#.#.###o#.#.#.#.#.#.#.#.#.###o##
####o#.#.#.#.#.#.#.#.###o###.#.#.#.#.#.#.#o#o#.#.#.#.#.#.#.#.#.###o###
#####.#.#.#.#.#.#.#.#.#o#o#.#.#.#.#.#.#.#o#o#o#.#.#.#.#.#.#.#.#.#o#o##
####o#.#.#.#.#.#.#.#.#.###o#.#.#.#.#.#.#.#o#o#.#.#.#.#.#.#.#.#.#o#####
#####o###o#o#o#o#.#######o###o###o#####o#.###o#o#o#####o###.###o######
##o###################o#o#o###########o#o#o#o#o#########o###o#o#######
#######o#o#o#########o###o#o###o#######.#o#o#o#.#o#o#######.#o#.######
########o###o#######o#o#.#o#o#########o#o###o#o#####o#o#.#o###o#o#o###
#####o#########o###o#o#o###o###o###.#######o#o#o#o#o#o#########o#o#o##
##o###o#o#####.#o#.###o#o#####o#############o#o#####o#o###o###########
###o#.#####.###.#####o#o###o###o#############o#.#o#o###.#.#####o#o####
##o#o###o#.#######o###o#o#o###o###o###########o#o#o#.#o#o###o#####o###
#######o#####o#####o#o#o#o#o###o###.#.#####o#o###o#.###o#####o########
##o#o###o#o#.#####o###o#o#o###o#####o#######o###o#o#o#o#######o###o###
#######o#o###o#####o#o#o#####o#o#o#o#########.#o#o#o#.#o###.#o########""")
panel_5 = Panel("""....................................................................
....................................................................
..................................#.#...............................
.................................#.#.#..............................
................................#.#.#.#.............................
.............................#.#.#.#.#.#.#..........................
............................#.#.#.#.#.#.###.........................
...........................#.#.#.#.#.#.#.#.#........................
.........................##.#.#.#.#.#.#.######......................
.......................#.#o#.#.#.#.#.#.#.#####.#....................
......................#o#o#.#.#.#.#.#.#.###o###.#.#.................
.....................#.###o#.#.#.#.#.#.#.#o#o#.#.#.#.#..............
..................#.#.#o#o#.#.#.#.#.#.#.#######.#.#.#.#.............
...........#.#.#.#.#.#o#o###.#.#.#.#.#.#.#o#o#.#.#.#.#.#............
......#...#.#.#.#.#.#.###o#.#.#.#.#.#.#.###o#o#.#.#.#.#.#.#.#.......
....##.#.#.#.#.#.#.#.#####o#.#.#.#.#.#.#.#####.#.#.#.#.#.#.#.#......
.####.#.#.#.#.#.#.#.#.#o###.#.#.#.#.#.#.#####o#.#.#.#.#.#.#.#.#.#...
##o###.#.#.#.#.#.#.#.#o#o#o#.#.#.#.#.#.#.#####.#.#.#.#.#.#.#.#.#o###
###o#.#.#.#.#.#.#.#.#.#####.#.#.#.#.#.#.#####o#.#.#.#.#.#.#.#.#.####
######.#.#.#.#.#.#.#.###o#o#.#.#.#.#.#.#.#####.#.#.#.#.#.#.#.#.#####
###o#.#.#.#.#.#.#.#.#.###o#.#.#.#.#.#.#.#######.#.#.#.#.#.#.#.#.####
######.#.#.#.#.#.#.#.#o#o#o#.#.#.#.#.#.#.#o###.#.#.#.#.#.#.#.#.#####
#####.#.#.#.#.#.#.#.#.###o#.#.#.#.#.#.#.###.###.#.#.#.#.#.#.#.#.####
##.#o#.#.#.#.#.#.#.#.###o#.#.#.#.#.#.#.#.#o###.#.#.#.#.#.#.#.#.#####
#####.#.#.#.#.#.#.#.#.###o#.#.#.#.#.#.#.#######.#.#.#.#.#.#.#.#.####
##o###.#.#.#.#.#.#.#.###.###.#.#.#.#.#.#.#####.#.#.#.#.#.#.#.#.#####
###o#.#.#.#.#.#.#.#.#.###o#.#.#.#.#.#.#.#######.#.#.#.#.#.#.#.#.####
##o#o#.#.#.#.#.#.#.#.###o#o#.#.#.#.#.#.#.#####.#.#.#.#.#.#.#.#.#.###
###o#.#.#.#.#.#.#.#.#.###.#.#.#.#.#.#.#.#######.#.#.#.#.#.#.#.#.####
##o#.#.#.#.#.#.#.#.#.#####o#.#.#.#.#.#.#.#####.#.#.#.#.#.#.#.#.#####
#####.#.#.#.#.#.#.#.#.#####.#.#.#.#.#.#.#o#####.#.#.#.#.#.#.#.#.####
##.###.#.#.#.#.#.#.#.#######.#.#.#.#.#.#.#####.#.#.#.#.#.#.#.#.#####
#####.#.#.#.#.#.#.#.#.###.#.#.#.#.#.#.#.###o###.#.#.#.#.#.#.#.#.#o##
######.#.#.#.#.#.#.#.#o#o#o#.#.#.#.#.#.#.#o###.#.#.#.#.#.#.#.#.#o###
###o#.#.#.#.#.#.#.#.#.#o###.#.#.#.#.#.#.###o###.#.#.#.#.#.#.#.#.####
##o#o#.#.#.#.#.#.#.#.#######.#.#.#.#.#.#.#####.#.#.#.#.#.#.#.#.#o###
#####.#.#.#.#.#.#.#.#.#####.#.#.#.#.#.#.#o###o#.#.#.#.#.#.#.#.#.#o##
######.#.#.#.#.#.#.#.#o#####.#.#.#.#.#.#.#.#o#.#.#.#.#.#.#.#.#.#####
#####.#.#.#.#.#.#.#.#.###o#.#.#.#.#.#.#.#o#o###.#.#.#.#.#.#.#.#.####
####.#.#.#.#.#.#.#.#.#o###o#.#.#.#.#.#.#.#o###.#.#.#.#.#.#.#.#.#####
###.#####o#####o#o#####################o###o#o#####.################
########o#o#o#########o#.###########o###o#o###o#####o###############
###o#o#######o#.###o#############o#####o#o#o###o#o#o#######.#o######
##.#######o###o#####o#o###o#.###########o#####o#o#o#######.#o#######
###########o###o#####o###o#############o###.#o#################.####
##o###.#o#####o###.#####o###o#o#.#######o#.#o###########o###########
###o###########o###o#o###o#o#o#o#####.###o#o#######o#.#o#########o##
##o#####o#####o#o###o#######o#######o#.###.#.#o#####o#########o#####
###o#########o#####.#####o#o#############o#####o#o#####o#######o####
##o###o#######.#####o#o#o#.#.###############.#.#.#o#.#o#.#o#.###o###
###o#.###########.###o#o###o#o#########o###o#####o#o#o#####o#####o##""")
panel_6 = Panel(""".....................................................................
.....................................................................
.....................................................................
.....................................................................
.....................................................................
...................................#.#...............................
..................................#.#.#.#............................
.................................#.#.#.#.####........................
................................#.#.#.#.######.......................
...............................#.#.#.#.#.#o#o#.#.....................
..............................#.#.#.#.#.###o###.#.#..................
.............................#.#.#.#.#.#.#o###.#.#.#.................
..................#.....###.#.#.#.#.#.#.#o#####.#.#.#................
...............#.#.#.#.###o#.#.#.#.#.#.#.#o###.#.#.#.#.#.............
..........#.#.#.#.#.###o###.#.#.#.#.#.#.#o#o#.#.#.#.#.#.#.#.#........
.......#.#.#.#.#.#.#.###o###.#.#.#.#.#.#.#o###.#.#.#.#.#.#.#.#.......
..#o#.#.#.#.#.#.#.#.###o#o#.#.#.#.#.#.#.#o###o#.#.#.#.#.#.#.#.#.#o##.
####o#.#.#.#.#.#.#.#.#.#.###.#.#.#.#.#.#.#####.#.#.#.#.#.#.#.#.######
#####.#.#.#.#.#.#.#.#####o#.#.#.#.#.#.#.#o#o###.#.#.#.#.#.#.#.#.#####
####.#.#.#.#.#.#.#.#.#o#o###.#.#.#.#.#.#.#.#o#.#.#.#.#.#.#.#.#.#o####
###o#.#.#.#.#.#.#.#.###.#o#.#.#.#.#.#.#.#######.#.#.#.#.#.#.#.#.#####
##o###.#.#.#.#.#.#.#.#o#o###.#.#.#.#.#.#.#####.#.#.#.#.#.#.#.#.#o#o##
#####.#.#.#.#.#.#.#.###o#o#.#.#.#.#.#.#.###.###.#.#.#.#.#.#.#.#.#####
####.#.#.#.#.#.#.#.#.###o#o#.#.#.#.#.#.#.#####.#.#.#.#.#.#.#.#.######
###o#.#.#.#.#.#.#.#.#o#o#o#.#.#.#.#.#.#.#######.#.#.#.#.#.#.#.#.#####
####o#.#.#.#.#.#.#.#.###o###.#.#.#.#.#.#.###o#.#.#.#.#.#.#.#.#.###.##
###o#.#.#.#.#.#.#.#.#o#o#o#.#.#.#.#.#.#.#o#####.#.#.#.#.#.#.#.#.#####
####o#.#.#.#.#.#.#.#.#o#.#o#.#.#.#.#.#.#.#####.#.#.#.#.#.#.#.#.#o####
#####.#.#.#.#.#.#.#.#o#o###.#.#.#.#.#.#.#.###o#.#.#.#.#.#.#.#.#.#o###
##o#o#.#.#.#.#.#.#.#.###o###.#.#.#.#.#.#.###o#.#.#.#.#.#.#.#.#.#o####
###o#.#.#.#.#.#.#.#.#o###.#.#.#.#.#.#.#.###o###.#.#.#.#.#.#.#.#.#####
##.###.#.#.#.#.#.#.#.#######.#.#.#.#.#.#.#####.#.#.#.#.#.#.#.#.#o####
###o#.#.#.#.#.#.#.#.#o#o###.#.#.#.#.#.#.#######.#.#.#.#.#.#.#.#.#####
##o#o#.#.#.#.#.#.#.#.#o###o#.#.#.#.#.#.#.#####.#.#.#.#.#.#.#.#.#o####
###o#.#.#.#.#.#.#.#.#####.#.#.#.#.#.#.#.###o###.#.#.#.#.#.#.#.#.#####
##o#o#.#.#.#.#.#.#.#.#o#####.#.#.#.#.#.#.#.###.#.#.#.#.#.#.#.#.#.####
###o#.#.#.#.#.#.#.#.#######.#.#.#.#.#.#.#######.#.#.#.#.#.#.#.#.#####
##o###.#.#.#.#.#.#.#.#o#####.#.#.#.#.#.#.#####.#.#.#.#.#.#.#.#.#o####
#####.#.#.#.#.#.#.#.###o###.#.#.#.#.#.#.###o###.#.#.#.#.#.#.#.#.#o###
##o#o#.#.#.#.#.#.#.#.#######.#.#.#.#.#.#.#####.#.#.#.#.#.#.#.#.###o##
#####o#o#o#####.#o#.#####o#####o#o###.###o#######o#####o#############
######o#o#.#####.#o#o###o#######o#o#o#######o#####################o##
#####o###.###o###o###o#########o#o#####o#o#######.###o#o#o###o#.#o###
########.#o#.#o#o#o#.###############o#o#o#################o#o#o#o####
#############o#######o#########o#o#####o###o###o###########.#####o###
##########o#o###o#o#o#.#o#.#################o###############o#o#o#o##
#############o#o#####o#o#############.#o###o#.#############o#.#o#o###
############o#o#o#o#o#####o#####o#o#o#o#####o#########.#######o######
#################o###o###o#o###o###o###o#o#o###o###.#################
################o###o#o#.#########o#o#######o#######o###o###o#####o##
#############o#.#o#o#.#o###o###########o#o#o###o#####o#######.#######""")
panel_7 = Panel("""....................................................................
....................................................................
....................................................................
....................................................................
....................................................................
.##.................................................................
##.#.#.#.#..........................................................
###.#.#.#.#.#.#.#...................................................
##.#.#.#.#.#.#.#.#.#................................................
###.#.#.#.#.#.#.#.#.#...............................................
##.#.#.#.#.#.#.#.#.#.#..............................................
###.#.#.#.#.#.#.#.#.#.#.............................................
##.#.#.#.#.#.#.#.#.#.#.#............................................
###.#.#.#.#.#.#.#.#.#.#.#..........................................#
##.#.#.#.#.#.#.#.#.#.#.#.#........................................##
###.#.#.#.#.#.#.#.#.#.#.#.........................................##
##.#.#.#.#.#.#.#.#.#.#.#.#.......................................###
###.#.#.#.#.#.#.#.#.#.#.#.#.....................................#.##
##.#.#.#.#.#.#.#.#.#.#.#.#.#...................................#.###
###.#.#.#.#.#.#.#.#.#.#.#.#.#.................................#.#.##
##.#.#.#.#.#.#.#.#.#.#.#.#.#.#...............................#.#.###
###.#.#.#.#.#.#.#.#.#.#.#.#.#.#.............................#.#.#.##
##.#.#.#.#.#.#.#.#.#.#.#.#.#.#.#.........................#.#.#.#.###
###.#.#.#.#.#.#.#.#.#.#.#.#.#.#.#.......................#.#.#.#.#.##
##.#.#.#.#.#.#.#.#.#.#.#.#.#.#.#.............#.....#...#.#.#.#.#.###
###.#.#.#.#.#.#.#.#.#.#.#.#.#.#.#.#.#.#.#.#.#.#.#.#.#.#.#.#.#.#.#.##
##.#.#.#.#.#.#.#.#.#.#.#.#.#.#.#.#.#.#.#.#.#.#.#.#.#.#.#.#.#.#.#.###
###.#.#.#.#.#.#.#.#.#.#.#.#.#.#.#.#.#.#.#.#.#.#.#.#.#.#.#.#.#.#.#.##
##.#.#.#.#.#.#.#.#.#.#.#.#.#.#.#.#.#.#.#.#.#.#.#.#.#.#.#.#.#.#.#.###
###.#.#.#.#.#.#.#.#.#.#.#.#.#.#.#.#.#.#.#.#.#.#.#.#.#.#.#.#.#.#.#.##
##.#.#.#.#.#.#.#.#.#.#.#.#.#.#.#.#.#.#.#.#.#.#.#.#.#.#.#.#.#.#.#.###
###.#.#.#.#.#.#.#.#.#.#.#.#.#.#.#.#.#.#.#.#.#.#.#.#.#.#.#.#.#.#.#.##
##.#.#.#.#.#.#.#.#.#.#.#.#.#.#.#.#.#.#.#.#.#.#.#.#.#.#.#.#.#.#.#.###
###.#.#.#.#.#.#.#.#.#.#.#.#.#.#.#.#.#.#.#.#.#.#.#.#.#.#.#.#.#.#.#.##
##.#.#.#.#.#.#.#.#.#.#.#.#.#.#.#.#.#.#.#.#.#.#.#.#.#.#.#.#.#.#.#.###
###.#.#.#.#.#.#.#.#.#.#.#.#.#.#.#.#.#.#.#.#.#.#.#.#.#.#.#.#.#.#.#.##
##.#.#.#.#.#.#.#.#.#.#.#.#.#.#.#.#.#.#.#.#.#.#.#.#.#.#.#.#.#.#.#.###
###.#.#.#.#.#.#.#.#.#.#.#.#.#.#.#.#.#.#.#.#.#.#.#.#.#.#.#.#.#.#.#.##
##.#.#.#.#.#.#.#.#.#.#.#.#.#.#.#.#.#.#.#.#.#.#.#.#.#.#.#.#.#.#.#.###
#########o###############o#o#o###o#####o#o#######o#o#####o#.########
##o###o#############o#######o#o#####o###o#o#####o#######o#o###.#####
###o#o#o#########o#######o#o#o###o#####o#####.###o#########o###o#.##""")
knots = KnotPattern(Wall=rods.Wall, Pattern=panel, Turn=90, Push=-50)  # -> Wall, Sheet, Report
knots_2 = KnotPattern(Wall=rods_2.Wall, Pattern=panel_2, Turn=90, Push=-50)  # -> Wall, Sheet, Report
knots_3 = KnotPattern(Wall=rods_3.Wall, Pattern=panel_3, Turn=90, Push=-50)  # -> Wall, Sheet, Report
knots_4 = KnotPattern(Wall=rods_4.Wall, Pattern=panel_4, Turn=90, Push=-50)  # -> Wall, Sheet, Report
knots_5 = KnotPattern(Wall=rods_5.Wall, Pattern=panel_5, Turn=90, Push=-50)  # -> Wall, Sheet, Report
knots_6 = KnotPattern(Wall=rods_6.Wall, Pattern=panel_6, Turn=90, Push=-50)  # -> Wall, Sheet, Report
knots_7 = KnotPattern(Wall=rods_7.Wall, Pattern=panel_7, Turn=90, Push=-50)  # -> Wall, Sheet, Report
bout = BrickOutputخروجیآجر(Wall=knots.Wall, Colour=1, Mortar=0)  # -> Bricks, Mesh, Problems, Warnings, Report, Legend, Mortar
panel_8 = Panel(knots.Report)
bout_2 = BrickOutputخروجیآجر(Wall=knots_2.Wall, Colour=1, Mortar=0)  # -> Bricks, Mesh, Problems, Warnings, Report, Legend, Mortar
panel_9 = Panel(knots_2.Report)
bout_3 = BrickOutputخروجیآجر(Wall=knots_3.Wall, Colour=1, Mortar=0)  # -> Bricks, Mesh, Problems, Warnings, Report, Legend, Mortar
panel_10 = Panel(knots_3.Report)
bout_4 = BrickOutputخروجیآجر(Wall=knots_4.Wall, Colour=1, Mortar=0)  # -> Bricks, Mesh, Problems, Warnings, Report, Legend, Mortar
panel_11 = Panel(knots_4.Report)
bout_5 = BrickOutputخروجیآجر(Wall=knots_5.Wall, Colour=1, Mortar=0)  # -> Bricks, Mesh, Problems, Warnings, Report, Legend, Mortar
panel_12 = Panel(knots_5.Report)
bout_6 = BrickOutputخروجیآجر(Wall=knots_6.Wall, Colour=1, Mortar=0)  # -> Bricks, Mesh, Problems, Warnings, Report, Legend, Mortar
panel_13 = Panel(knots_6.Report)
bout_7 = BrickOutputخروجیآجر(Wall=knots_7.Wall, Colour=1, Mortar=0)  # -> Bricks, Mesh, Problems, Warnings, Report, Legend, Mortar
panel_14 = Panel(knots_7.Report)
pt_8 = Point([Point(10.787, -0.1, 18.55), Point(11.743, 6.7431, 18.55), Point(12.699, 13.5862, 18.55)])
pt_9 = Point([Point(10.9659, -0.3075, 15.35), Point(11.783, 6.6463, 15.35), Point(12.6, 13.6, 15.35)])
pt_10 = Point([Point(10.7428, -0.0492, 12.15), Point(11.82, 6.7546, 12.15), Point(12.8971, 13.5585, 12.15)])
pt_11 = Point([Point(11.01, -0.3601, 8.95), Point(11.8298, 6.6165, 8.95), Point(12.6495, 13.5931, 8.95)])
pt_12 = Point([Point(10.7, 0, 5.75), Point(11.8233, 6.7758, 5.75), Point(12.9466, 13.5516, 5.75)])
pt_13 = Point([Point(10.9209, -0.2552, 2.55), Point(11.7605, 6.6724, 2.55), Point(12.6, 13.6, 2.55)])
pt_14 = Point([Point(10.7, 0, 0.15), Point(11.65, 6.8, 0.15), Point(12.6, 13.6, 0.15)])
intcrv_8 = Interpolate(Vertices=pt_8, Degree=3, Periodic=False, KnotStyle=0)  # -> Curve, Length, Domain
intcrv_9 = Interpolate(Vertices=pt_9, Degree=3, Periodic=False, KnotStyle=0)  # -> Curve, Length, Domain
intcrv_10 = Interpolate(Vertices=pt_10, Degree=3, Periodic=False, KnotStyle=0)  # -> Curve, Length, Domain
intcrv_11 = Interpolate(Vertices=pt_11, Degree=3, Periodic=False, KnotStyle=0)  # -> Curve, Length, Domain
intcrv_12 = Interpolate(Vertices=pt_12, Degree=3, Periodic=False, KnotStyle=0)  # -> Curve, Length, Domain
intcrv_13 = Interpolate(Vertices=pt_13, Degree=3, Periodic=False, KnotStyle=0)  # -> Curve, Length, Domain
intcrv_14 = Interpolate(Vertices=pt_14, Degree=3, Periodic=False, KnotStyle=0)  # -> Curve, Length, Domain
rods_8 = RodScreen(Curve=intcrv_8.Curve, Height=1.5, Format="Iranian 20x10x5", Gap=5, Holes=1, Spacing=110, Rod=12, Knots=True)  # -> Wall, Rods, RodPipes, Report
rods_9 = RodScreen(Curve=intcrv_9.Curve, Height=2.85, Format="Iranian 20x10x5", Gap=5, Holes=1, Spacing=110, Rod=12, Knots=True)  # -> Wall, Rods, RodPipes, Report
rods_10 = RodScreen(Curve=intcrv_10.Curve, Height=2.85, Format="Iranian 20x10x5", Gap=5, Holes=1, Spacing=110, Rod=12, Knots=True)  # -> Wall, Rods, RodPipes, Report
rods_11 = RodScreen(Curve=intcrv_11.Curve, Height=2.85, Format="Iranian 20x10x5", Gap=5, Holes=1, Spacing=110, Rod=12, Knots=True)  # -> Wall, Rods, RodPipes, Report
rods_12 = RodScreen(Curve=intcrv_12.Curve, Height=2.85, Format="Iranian 20x10x5", Gap=5, Holes=1, Spacing=110, Rod=12, Knots=True)  # -> Wall, Rods, RodPipes, Report
rods_13 = RodScreen(Curve=intcrv_13.Curve, Height=2.85, Format="Iranian 20x10x5", Gap=5, Holes=1, Spacing=110, Rod=12, Knots=True)  # -> Wall, Rods, RodPipes, Report
rods_14 = RodScreen(Curve=intcrv_14.Curve, Height=2.35, Format="Iranian 20x10x5", Gap=5, Holes=1, Spacing=110, Rod=12, Knots=True)  # -> Wall, Rods, RodPipes, Report
panel_15 = Panel("""###o#o#####o#######o#############o###.#o#o#o#o#o#######o###o#o#######o#o###o###o########
####.#o#o#######o#.#.#o#.###o#####o###o#o#o#o#o###o#######o###o###o#o###o#o#.#o###o#####
#####o###.#o###o#o#o###########o#############o#o#####o###.#o#####o###o#o###########o####
######o#o#####o###o#o#o###o###########o###o###.###.#o###o#o#####o#.#o###o#o#o###########
#####o#o#########o#o#####################o###o#o#o#.#o#o#o#.#####o#o###o#o###o##########
##o###o#o#####.#.#.#####o###########.#####o###o#o###o###o#o#####.###o###o#.#####.###o###
#####o#.#o#o###o#o#.#o###o#########o#o#o#####o#o###.#o#####o#o#####o#o###o###o#######o##
##o#####o#####o#o#.#.#.#####o###o#########o#o#######o#####o#.#####.#######o#o###########
###o###o#######o#o###o###o###########o#o#o#o#o#o#o#o#o###########.#####o#o#o#####o#o#o##
##.#o#o#o###########o#o#####o#####o#############.#######o#####o#####o#####o#o#######o###
###o#o#########o#o#####.#######o#o#####.#####.#o#o###o#####.###o#####o###o#o#o#####.####
##o#o#o#####o#o###o#####o###.###o###o#o#.###o###o###o###o###o#########.#o#o#####.#o#o###
###o#o#o#o#######o#####o#o#######o#o#.#####o#o###o#o#o#o###.#o#############.#o###o#o####
##o#o###.#########o#.#####o#######o#o###o#o###o#o#o#.#o#####o#o#####o###o#########o#####
#####o#o#.#o#########o###o#####o#o#o#########o#o#########################o#o#.#o###o####
##o#o#o#o#####o#########o#####o#o#o#####o###o#######.###o###############o###o###o#o#.###
#####o#o#######o#o#######o###o#o#####o#o#####o#.###o#.#o#o#########o#######o###o#o#o#o##
##o#o#o#######o###o###o#####.###o#o#o#o#.###o#######o#####o#######o#######.#####o###o###
###o#o###########o#########o#.#o#####o#.#o#############o###.#############o#o###o#o###o##
####.#.#########################o#o#.#####o#######o#o#o#o###o#####o#########.#o#o#o#####
###.#.#########o#############o#o#o#o#o#####.#o#####.#########o#o#######.#########.###o##
##o#o#o#o#######o#####o#####.###o#o#####o#####o###o#######o#o#o###o#######o#o#.#o#######
#####o#o###########o#.#########o#o#o#o#############o#o#o###o###o###o#o###o#####o#o######
####.#o#####o###o###################o#o#.###o#######o#o###o###o#o#.###############o#####
###o#o#########o#####.###o#o###o#o#####o###.###.###############o#o#######o#####o########
##o#o#o#.###o#################o#o#.#.#o#o#######o#######.###o#######o#########o#########
#############o#####o###########.#o#o#o#o#o###################o#o#o#o#############o#o#o##""")
panel_16 = Panel("""..........................................................................................
.......................................................#.#................................
....................................................#.#.#.#...............................
................................................o###o#.#.#.#..............................
............................................#.#.###o#.#.#.#.#.............................
.........................................#.#.#.#######.#.#.#.#............................
........................................#.#.#.#.#o###.#.#.#.#.##..........................
.........................................#.#.#.#o#####.#.#.#.#####o#......................
...................................##.#.#.#.#.#.###o#.#.#.#.#.###o#.#.....................
..................................##.#.#.#.#.#.#o#####.#.#.#.#o#####.#....................
.................................####.#.#.#.#.#.###o#.#.#.#.#.#####.#.#...................
.............................###o#.#.#.#.#.#.#.###.#o#.#.#.#.###.#o#.#.#..................
............................#.#o###o#.#.#.#.#.#.#####.#.#.#.#.###.#.#.#.#.#.#.............
...........................#.###o###.#.#.#.#.#.###o###.#.#.#.###.###.#.#.#.#.#.#..........
......................#...#.#.#.#o#o#.#.#.#.#.#.#.###.#.#.#.#.#o###.#.#.#.#.#.#.#.#.......
...................#.#.#.#.#.###o#o#.#.#.#.#.#.#o#####.#.#.#.#.#####.#.#.#.#.#.#.#.#o###..
................#.#.#.#.#.#.#.#o#o###.#.#.#.#.#.#.###.#.#.#.#.###o#.#.#.#.#.#.#.#.#.#o#o#.
#####..#.#.#.#.#.#.#.#.#.#.#.###o#o#.#.#.#.#.#.#######.#.#.#.#o#o###.#.#.#.#.#.#.#.#o#o###
#####.#.#.#.#.#.#.#.#.#.#.#.#.###o###.#.#.#.#.#.#####.#.#.#.#.#o#o#.#.#.#.#.#.#.#.#.#o#o##
######.#.#.#.#.#.#.#.#.#.#.#.#o###o#.#.#.#.#.#.#######.#.#.#.###.#o#.#.#.#.#.#.#.#.#o#o###
###o#o#.#.#.#.#.#.#.#.#.#.#.#.#o#.#.#.#.#.#.#.#.###o#.#.#.#.#.#o###.#.#.#.#.#.#.#.#.###o##
##o###.#.#.#.#.#.#.#.#.#.#.#.#.###o#.#.#.#.#.#.#######.#.#.#.#o###.#.#.#.#.#.#.#.#.###o###
#####o#.#.#.#.#.#.#.#.#.#.#.#.#####o#.#.#.#.#.#.#####.#.#.#.#.###o#.#.#.#.#.#.#.#.#.#o####
######.#.#.#.#.#.#.#.#.#.#.#.###o###.#.#.#.#.#.###.###.#.#.#.#o#o###.#.#.#.#.#.#.#.#######
###o###.#.#.#.#.#.#.#.#.#.#.#.###o#o#.#.#.#.#.#.#####.#.#.#.#.#o#o#.#.#.#.#.#.#.#.#.#o####
####o#.#.#.#.#.#.#.#.#.#.#.#.###o###.#.#.#.#.#.#######.#.#.#.#.#o#.#.#.#.#.#.#.#.#.#.#o###
#######.#.#.#.#.#.#.#.#.#.#.#.###.#o#.#.#.#.#.#.###.#.#.#.#.#.#####.#.#.#.#.#.#.#.#.#o#.##
######.#.#.#.#.#.#.#.#.#.#.#.###o###.#.#.#.#.#.#o#.###.#.#.#.#o#o#o#.#.#.#.#.#.#.#.#######
###o#.#.#.#.#.#.#.#.#.#.#.#.#.###.###.#.#.#.#.#.#o###.#.#.#.#.#o#.#.#.#.#.#.#.#.#.#.#o####
######.#.#.#.#.#.#.#.#.#.#.#.#####o#.#.#.#.#.#.#o#####.#.#.#.###o#o#.#.#.#.#.#.#.#.#######
#######.#.#.#.#.#.#.#.#.#.#.#.#o#.#o#.#.#.#.#.#.#o###.#.#.#.#.###o#.#.#.#.#.#.#.#.#.######
####o#.#.#.#.#.#.#.#.#.#.#.#.#######.#.#.#.#.#.#o#####.#.#.#.#o#o###.#.#.#.#.#.#.#.#o#####
###.###.#.#.#.#.#.#.#.#.#.#.#.#o#.###.#.#.#.#.#.#o###.#.#.#.#.###o#.#.#.#.#.#.#.#.#.#o####
####o#.#.#.#.#.#.#.#.#.#.#.#.#o###o#.#.#.#.#.#.#o#####.#.#.#.#####o#.#.#.#.#.#.#.#.#.#####
###.###.#.#.#.#.#.#.#.#.#.#.#.###o#o#.#.#.#.#.#.###o#.#.#.#.#.#o#o#.#.#.#.#.#.#.#.#.#o####
####o#.#.#.#.#.#.#.#.#.#.#.#.#######.#.#.#.#.#.#######.#.#.#.###o#o#.#.#.#.#.#.#.#.###.###
###o#o#.#.#.#.#.#.#.#.#.#.#.#.#o#o###.#.#.#.#.#.#####.#.#.#.#.#o#o#.#.#.#.#.#.#.#.#.######
######.#.#.#.#.#.#.#.#.#.#.#.#######.#.#.#.#.#.#######.#.#.#.#o#o###.#.#.#.#.#.#.#.#o#####
#####.#.#.#.#.#.#.#.#.#.#.#.#.###o###.#.#.#.#.#.#####.#.#.#.#.#####.#.#.#.#.#.#.#.#.#o####
##o#o#.#.#.#.#.#.#.#.#.#.#.#.#o#o###.#.#.#.#.#.#######.#.#.#.#o#.###.#.#.#.#.#.#.#.#######
###o#######o#o###.#####o###o###o###o#o###o###.#######o###o#.#####o#######o#.###o##########
##o#o#######o#######o#o#####.#o#o#o#o#####o#######o###########o###o###o#o###o#o#.#o#o#####
#######o#o#########.#o#######o###o#o#o#########.#o###o#o#.#o#o#o#o#########.#o#.###.###.##
####o#o#o#o#o#############.###.#o#######o###o#o###o#o#######.#o#.#########o###o#o#o#o#####
###o#####.#################o#####o#o#######o###o###.###o#.#o#####.###o#o#o#.#o###o###.####
##o#o#####o#o#####o#######.#####o#######o###.#o###o#o###o#######o#########o#####o#o#o#o###
###o###o#o#o#########o#######.#o#o#####o#.###.#o#o###o#o#####o###o#.###########o#o#o###o##
####o#o#######################o#o#o#####o#######o#####o#o#o#o#o###o###########o###o###o###
###o#######o#o#####.#######o#o###o###############o#.#o###o#o#o#o#####.#o###########o#o####
######o#############.#######o#.#o#.#########o#########o###o#o#o###.#o#######o###o#o#o#####
#####.###o#o#.###o###########o#o###o###o#o#o#######o#######o#o###.#########o#o#o#o###o#o##""")
panel_17 = Panel("""........................................................................................
........................................................................................
..........................................................#.............................
.........................................................#.#.#o#........................
......................................................#.#.#.#o#o#.......................
.................................................###.#.#.#.#.###o#o.....................
..............................................#####.#.#.#.#.#####o#.....................
.............................................#.###o###.#.#.#.###.###....................
........................................#.#.#.###.#o#.#.#.#.#o#o###.#...................
.......................................#.#.#.#.###o#o#.#.#.#.#o#o###.#..................
.................................##o#.#.#.#.#.#####o#.#.#.#.###o###.#.#.#...............
................................o#o#.#.#.#.#.#.###o#o#.#.#.#.#####o#.#.#.#..............
.............................o#o#####.#.#.#.#.###o#.#.#.#.#.#######.#.#.#.#.............
...........................#.###o#o#.#.#.#.#.#.#o#####.#.#.#.#.#####.#.#.#.#............
..................#.......#.#o#o#####.#.#.#.#.#.###o#.#.#.#.#####o#.#.#.#.#.#.#.#.......
.............#...#.#.#.#.#.#.#o#o###.#.#.#.#.#.#o#o#o#.#.#.#.#o#####.#.#.#.#.#.#.#......
............#.#.#.#.#.#.#.#.#o###o###.#.#.#.#.###o#o#.#.#.#.#######.#.#.#.#.#.#.#.####..
.........#.#.#.#.#.#.#.#.#.#.#####o#.#.#.#.#.#.#o#o#.#.#.#.#.#o#o#o#.#.#.#.#.#.#.#.#####
...#..#.#.#.#.#.#.#.#.#.#.#.#####o###.#.#.#.#.#######.#.#.#.###.###.#.#.#.#.#.#.#.###o##
######.#.#.#.#.#.#.#.#.#.#.#.#.###.#.#.#.#.#.#.###o#o#.#.#.#.#o#####.#.#.#.#.#.#.#.#o###
###o#.#.#.#.#.#.#.#.#.#.#.#.#o#######.#.#.#.#.#######.#.#.#.#######.#.#.#.#.#.#.#.###o##
######.#.#.#.#.#.#.#.#.#.#.#.#o#####.#.#.#.#.#.#####o#.#.#.#.#####o#.#.#.#.#.#.#.#.#####
#####.#.#.#.#.#.#.#.#.#.#.#.#########.#.#.#.#.#######.#.#.#.#.#o###.#.#.#.#.#.#.#.###o##
######.#.#.#.#.#.#.#.#.#.#.#.#o#####.#.#.#.#.#.###o###.#.#.#.#o#####.#.#.#.#.#.#.#.#.###
#####.#.#.#.#.#.#.#.#.#.#.#.###.###o#.#.#.#.#.#####o#.#.#.#.###.#o#.#.#.#.#.#.#.#.#o####
######.#.#.#.#.#.#.#.#.#.#.#.###o#o#.#.#.#.#.#.###o###.#.#.#.#####o#.#.#.#.#.#.#.#.#####
#####.#.#.#.#.#.#.#.#.#.#.#.###.#.###.#.#.#.#.###o###.#.#.#.#o###o#.#.#.#.#.#.#.#.######
######.#.#.#.#.#.#.#.#.#.#.#.#######.#.#.#.#.#.###o#o#.#.#.#.#o#####.#.#.#.#.#.#.#.#####
#####.#.#.#.#.#.#.#.#.#.#.#.#######o#.#.#.#.#.#o#####.#.#.#.###o###.#.#.#.#.#.#.#.######
######.#.#.#.#.#.#.#.#.#.#.#.#.#####.#.#.#.#.#.#####o#.#.#.#.#o###o#.#.#.#.#.#.#.#.#####
#####.#.#.#.#.#.#.#.#.#.#.#.#######o#.#.#.#.#.#######.#.#.#.#o#o#o#.#.#.#.#.#.#.#.######
######.#.#.#.#.#.#.#.#.#.#.#.#######.#.#.#.#.#.###o#.#.#.#.#.#####.#.#.#.#.#.#.#.#.#####
#####.#.#.#.#.#.#.#.#.#.#.#.#########.#.#.#.#.#####o#.#.#.#.###o###.#.#.#.#.#.#.#.#o####
######.#.#.#.#.#.#.#.#.#.#.#.#######.#.#.#.#.#.#.#o#.#.#.#.#.#o#o###.#.#.#.#.#.#.#.#####
#####.#.#.#.#.#.#.#.#.#.#.#.#########.#.#.#.#.#o#o#o#.#.#.#.#o#####.#.#.#.#.#.#.#.######
##.###.#.#.#.#.#.#.#.#.#.#.#.#######.#.#.#.#.#.#o#####.#.#.#.#####o#.#.#.#.#.#.#.#.#####
#####.#.#.#.#.#.#.#.#.#.#.#.#####.###.#.#.#.#.#####o#.#.#.#.#######.#.#.#.#.#.#.#.######
##.###.#.#.#.#.#.#.#.#.#.#.#.#######.#.#.#.#.#.#o###.#.#.#.#.#######.#.#.#.#.#.#.#.#####
#####.#.#.#.#.#.#.#.#.#.#.#.#o#######.#.#.#.#.###o###.#.#.#.#######.#.#.#.#.#.#.#.#.####
##o###.#.#.#.#.#.#.#.#.#.#.#.#######.#.#.#.#.#.#o#o#o#.#.#.#.#o###o#.#.#.#.#.#.#.#.#####
###################o#o#o#o###############o#o#.###o#o###.#############o#o#o#o#o#####.####
##o###o#######o#o#.#o#o#o#o###############o###o#o#o###o###o#########o#o#o#o#o###o#######
#####################o#o#o#######.#####o#.###o#.#####.#####o#######o###.###o#o#o###o####
##.#############o#o#o#o#o###o###############o#o###o#o###o#o#####o###.###.###o#o#o#######
###o###########o#####o#o#o###.#########o#########o#o#o###o#o#o#########o#o###o#o#o######
######o#.#.#######o#o#o###o#######o#########o###o#o#o#o#########o#####o#######o###o#o###
#####o###o#####o#o###o#.#o#.###o###o###o#####.###o#o#o#o#.#####################o#o#o#o##
##o###o#######o#o###o#o#####o#.#####o#o#############.#o#.###o###############o#o#o#o#o###
###o#################o#o#o#####o#o#o###.###########o#####o#o###########.#####o#o#o#o####
##.#.#o###########o#######o#####o#o#o#####o#######o#o#####o#o#######o#.#######o#o#o#####
###.###o#######o#####o#####o#####o#.#####o#.#######o#o#o###o#o#o###o###.#o#o###o#o#o#o##""")
panel_18 = Panel("""..........................................................................................
..........................................................................................
............................................#.....#o#...#.#...#...........................
.......................................#.#.#.#.#######.#.#.#.###o.........................
....................................#.#.#.#.#.###o#o#.#.#.#.#.#o#o#.......................
..................................o#.#.#.#.#.#.###o###.#.#.#.#o#o#o#......................
.................................##o#.#.#.#.#.#.#o###.#.#.#.#.#o#o#.#.....................
................................####.#.#.#.#.#.#######.#.#.#.#.###o#.#....................
..........................#..##o#####.#.#.#.#.#######.#.#.#.#.#o###.#.....................
.........................#.#.#o#o###.#.#.#.#.#.#o#o#o#.#.#.#.#####o#.#....................
......................#.#.#.#########.#.#.#.#.#o#o#o#.#.#.#.#.#####.#.#...................
.....................#.#.#.#.###o###.#.#.#.#.#.#######.#.#.#.#o#####.#.#..................
..................#.#.#.#.#.#########.#.#.#.#.#o#o###.#.#.#.#.###o#.#.#.#.#...............
...............#.#.#.#.#.#.#.#o#o###.#.#.#.#.#.#o#####.#.#.#.#o#o###.#.#.#.#.#............
..........#.#.#.#.#.#.#.#.#.#.#####o#.#.#.#.#.#o#.###.#.#.#.#.###.#.#.#.#.#.#.#...........
..####.#.#.#.#.#.#.#.#.#.#.#.###.###.#.#.#.#.#.#######.#.#.#.#o#.#o#.#.#.#.#.#.#.#.#......
.##o#.#.#.#.#.#.#.#.#.#.#.#.#.#######.#.#.#.#.#o###o#.#.#.#.#.#o#o#.#.#.#.#.#.#.#.#.#.....
##.###.#.#.#.#.#.#.#.#.#.#.#.###o###.#.#.#.#.#.#.#####.#.#.#.#o###o#.#.#.#.#.#.#.#.###....
#####.#.#.#.#.#.#.#.#.#.#.#.#####o###.#.#.#.#.###o#o#.#.#.#.#.#o#o#.#.#.#.#.#.#.#.#.####..
##o#o#.#.#.#.#.#.#.#.#.#.#.#.###o###.#.#.#.#.#.###o#o#.#.#.#.#o###o#.#.#.#.#.#.#.#.###o###
#####.#.#.#.#.#.#.#.#.#.#.#.#o#o#####.#.#.#.#.###o###.#.#.#.#.#.#o#.#.#.#.#.#.#.#.#.######
######.#.#.#.#.#.#.#.#.#.#.#.#####o#.#.#.#.#.#.#####o#.#.#.#.#######.#.#.#.#.#.#.#.#o#o###
###o#.#.#.#.#.#.#.#.#.#.#.#.#####.#o#.#.#.#.#.#####.#.#.#.#.#.#o###.#.#.#.#.#.#.#.#.#o####
##o###.#.#.#.#.#.#.#.#.#.#.#.#o###o#.#.#.#.#.#.#######.#.#.#.#######.#.#.#.#.#.#.#.#o#####
###.#.#.#.#.#.#.#.#.#.#.#.#.#o#o#o#o#.#.#.#.#.###o###.#.#.#.#.###o#.#.#.#.#.#.#.#.#.#o#o##
##o###.#.#.#.#.#.#.#.#.#.#.#.#o###o#.#.#.#.#.#.#o###.#.#.#.#.#o#o#o#.#.#.#.#.#.#.#.#o#o###
###o#.#.#.#.#.#.#.#.#.#.#.#.#######o#.#.#.#.#.#####o#.#.#.#.#.###o#.#.#.#.#.#.#.#.#.###o##
##o#o#.#.#.#.#.#.#.#.#.#.#.#.#.###o#.#.#.#.#.#.#####o#.#.#.#.###o###.#.#.#.#.#.#.#.###o###
#####.#.#.#.#.#.#.#.#.#.#.#.#######o#.#.#.#.#.#######.#.#.#.#.###o#.#.#.#.#.#.#.#.#.#o#.##
####o#.#.#.#.#.#.#.#.#.#.#.#.#####o#.#.#.#.#.#.###o###.#.#.#.#o###o#.#.#.#.#.#.#.#.###o###
#####.#.#.#.#.#.#.#.#.#.#.#.###o###.#.#.#.#.#.###.#o#.#.#.#.#.#o#o#.#.#.#.#.#.#.#.#.#o#o##
######.#.#.#.#.#.#.#.#.#.#.#.###o#o#.#.#.#.#.#.#####o#.#.#.#.#######.#.#.#.#.#.#.#.#o#o###
#####.#.#.#.#.#.#.#.#.#.#.#.#o#######.#.#.#.#.#o#####.#.#.#.#.#o###.#.#.#.#.#.#.#.#.#o#o##
##o###.#.#.#.#.#.#.#.#.#.#.#.#####o#.#.#.#.#.#.#o#o###.#.#.#.#####o#.#.#.#.#.#.#.#.###o###
###o#.#.#.#.#.#.#.#.#.#.#.#.#######o#.#.#.#.#.#o#o#.#.#.#.#.#.#####.#.#.#.#.#.#.#.#.#o####
##o#o#.#.#.#.#.#.#.#.#.#.#.#.#######.#.#.#.#.#.###o###.#.#.#.#o#o###.#.#.#.#.#.#.#.###o###
#####.#.#.#.#.#.#.#.#.#.#.#.#########.#.#.#.#.###o###.#.#.#.#.#o###.#.#.#.#.#.#.#.#.######
######.#.#.#.#.#.#.#.#.#.#.#.#######.#.#.#.#.#.#######.#.#.#.###o###.#.#.#.#.#.#.#.#o#####
#####.#.#.#.#.#.#.#.#.#.#.#.#########.#.#.#.#.#.#o#o#.#.#.#.#.#o#o#.#.#.#.#.#.#.#.#.###o##
######.#.#.#.#.#.#.#.#.#.#.#.#######.#.#.#.#.#.#o###o#.#.#.#.#o#o#o#.#.#.#.#.#.#.#.###o###
###o###.#o###o#o#o###o#o#########o###########o#o###.#####.###o#o#######o#o################
####o#o#.#.###o#o#.#######o###.###.#####o#o#o#######o#####.###########o#o#o###o###########
#########.#o###o#o###o#.#.###o#######o#####o#o#####o#o###o#######o#o#####o#o#o#########o##
##o#o#o#o#o###o###o#o###########o#o###.#####o#.#######################o#o#####o###########
#######o#o###.#######o#o#####o#############o#o#.#o###o#o#.#####o#o#.#o#o#o###o#########.##
####o###########.#.#####o#o###o#.#.#o#.###########o#####o#o#################.#o###########
#####o#o#.###o###o#o#o###o#o###o###########o#o#.#o#o#####.#####.#########o###o############
####o###o#o#####o###o#o#o#o#####o###o#########o#.#o#o#####o#################o#o###o###o###
#######o#######o#.#.#o#o#o###o#o###o#o#####o###.#o###o#####o###############o###o#o#o###.##
##o#o###o#####.#####o###o#o#######o###.#####.#.#o###o#o#o###.#o#o#########o#######o#o#####
###o#o#o#####.#.###o#.#o#o#o#o#o#############o###o#o###o#o#o#######################o######""")
panel_19 = Panel("""...............................................................#........................
..............................................................##o.......................
............................................................#.#o#o......................
.....................................................#.#.#.#.###o##.....................
...................................................##.#.#.#.#.###o#.....................
..................................................##.#.#.#.#.#o#.#o#....................
................................................#o###.#.#.#.#.#o###.#.#.................
.............................................#.###.###.#.#.#.###o#o#.#.#................
............................................#.#o#####.#.#.#.#.###.#.#.#.#...............
.........................................#.#.#.#o#.#o#.#.#.#.###o###.#.#.#..............
......................................#.#.#.#.###o#o#.#.#.#.#.#o#o#.#.#.#.#.............
.....................................#.#.#.#.#.#.#####.#.#.#.###o#o#.#.#.#.#............
....................................#.#.#.#.#.###o###.#.#.#.#.#####.#.#.#.#.#...........
...................................#.#.#.#.#.#.#######.#.#.#.#.###o#.#.#.#.#.#..........
.................................####.#.#.#.#.###o###.#.#.#.#.###o#.#.#.#.#.#.#.#.......
................................####.#.#.#.#.#.#######.#.#.#.#o#o#o#.#.#.#.#.#.#.#.#####
................#.#.#.#.#.#.#########.#.#.#.#.#o#o###.#.#.#.#.#o###.#.#.#.#.#.#.#.#.####
...............#.#.#.#.#.#.#.#######.#.#.#.#.#.#######.#.#.#.#######.#.#.#.#.#.#.#.#####
#####.....#.#.#.#.#.#.#.#.#.#########.#.#.#.#.#####o#.#.#.#.#.#o#o#.#.#.#.#.#.#.#.#.####
##o###.#.#.#.#.#.#.#.#.#.#.#.#######.#.#.#.#.#.#o#o###.#.#.#.###o#o#.#.#.#.#.#.#.#.#o###
#####.#.#.#.#.#.#.#.#.#.#.#.#########.#.#.#.#.###o#o#.#.#.#.#.#####.#.#.#.#.#.#.#.#.####
######.#.#.#.#.#.#.#.#.#.#.#.#o#####.#.#.#.#.#.#o#o###.#.#.#.#####o#.#.#.#.#.#.#.#.#o###
###.#.#.#.#.#.#.#.#.#.#.#.#.###o#o###.#.#.#.#.#o###o#.#.#.#.#.#####.#.#.#.#.#.#.#.#.#o##
##o###.#.#.#.#.#.#.#.#.#.#.#.#######.#.#.#.#.#.###o###.#.#.#.#######.#.#.#.#.#.#.#.#o###
#####.#.#.#.#.#.#.#.#.#.#.#.#####.###.#.#.#.#.#####o#.#.#.#.#.#####.#.#.#.#.#.#.#.#.#.##
##o###.#.#.#.#.#.#.#.#.#.#.#.#.###o#.#.#.#.#.#.#o#o###.#.#.#.#####o#.#.#.#.#.#.#.#.#o###
#####.#.#.#.#.#.#.#.#.#.#.#.###o#####.#.#.#.#.###o###.#.#.#.#.#####.#.#.#.#.#.#.#.#.####
##o###.#.#.#.#.#.#.#.#.#.#.#.#######.#.#.#.#.#.#######.#.#.#.###o###.#.#.#.#.#.#.#.#o###
#####.#.#.#.#.#.#.#.#.#.#.#.###o#o###.#.#.#.#.#.#o###.#.#.#.#.#####.#.#.#.#.#.#.#.#.#o##
####o#.#.#.#.#.#.#.#.#.#.#.#.#######.#.#.#.#.#.#######.#.#.#.#######.#.#.#.#.#.#.#.#o###
#####.#.#.#.#.#.#.#.#.#.#.#.#o###o###.#.#.#.#.#######.#.#.#.#.#o###.#.#.#.#.#.#.#.#.####
######.#.#.#.#.#.#.#.#.#.#.#.#o#o###.#.#.#.#.#.#o#####.#.#.#.###o###.#.#.#.#.#.#.#.#.###
#####.#.#.#.#.#.#.#.#.#.#.#.#.#####o#.#.#.#.#.###.###.#.#.#.#.#o#o#.#.#.#.#.#.#.#.#.####
######.#.#.#.#.#.#.#.#.#.#.#.###.#o#.#.#.#.#.#.#####o#.#.#.#.#######.#.#.#.#.#.#.#.#o###
###o#.#.#.#.#.#.#.#.#.#.#.#.#o#o#o#o#.#.#.#.#.#######.#.#.#.#.#####.#.#.#.#.#.#.#.#.####
##.###.#.#.#.#.#.#.#.#.#.#.#.###o#o#.#.#.#.#.#.#####o#.#.#.#.#o###o#.#.#.#.#.#.#.#.#.###
#####.#.#.#.#.#.#.#.#.#.#.#.#####o###.#.#.#.#.#.###o#.#.#.#.#.#####.#.#.#.#.#.#.#.#.####
######.#.#.#.#.#.#.#.#.#.#.#.#o#o#o#.#.#.#.#.#.#.#####.#.#.#.###o###.#.#.#.#.#.#.#.#o###
#####.#.#.#.#.#.#.#.#.#.#.#.#######o#.#.#.#.#.#######.#.#.#.#.#o###.#.#.#.#.#.#.#.#.#o##
##o#o#.#.#.#.#.#.#.#.#.#.#.#.#####o#.#.#.#.#.#.#####o#.#.#.#.#o###o#.#.#.#.#.#.#.#.#.###
###o###o#####o#o#o#####o#o#######.#####o#o#o#######o#o#####o#####o#o###o#o#o###o#.###o##
######o###o#o#o#o#o#####.###########o#o#o###o###o#o###o###################.#o#o#o#o#####
#####o###.###o#o#o#########o#########o#o#.#o#o#####o###o###o#############o#o#.#o#o#o#o##
####o#o###############o#############.#o#o#.#####o#o#o###################o###o#o###o#####
###.###########o#o#o###o#o###o#####o###o#o#o###o#o###############o#o#o#o#o#o#o#######o##
##############o#####o###########o###o#####o###o#o#o###o#.#####o###.###o#o###o#o#o#o#.###
#######.#########o#o#####o#######o#o#o#######o#o#########################o#o###.#o#o####
##o###########o#o#o#########o#############o#o#o#o#o#o#o#######.#######o#o#####.#o#o#o###
###########o#o#o#o###########.#o#####o#####o###o#o#o#o#.#o#####.#.###o#o###o#o#o########
##o#############o#o#.#o#####.###o#o#######.#o#####o#.#######o#.###########o#o#o#o#######
###################.#########o#o#############o###o#o#o#o###o###o#o#o###.###o#####o#.####""")
panel_20 = Panel(""".........................................................................................
.........................................................................................
.........................................................................................
.........................................................................................
.........................................................................................
.........................................................................................
.........................................................................................
.........................#...............................................................
......................#.#.#.#............................................................
...............#.....#.#.#.#.###o###.....................................................
..............#.#.#.#.#.#.#.#.###o###.#..................................................
.........#.#.#.#.#.#.#.#.#.#.#.###o#.#.#.#...............................................
......#.#.#.#.#.#.#.#.#.#.#.#########.#.#.#.#.#####.#.......#............................
....##.#.#.#.#.#.#.#.#.#.#.#.###o###.#.#.#.#.#.#o#.#o#.#...#.##..........................
##.##.#.#.#.#.#.#.#.#.#.#.#.#########.#.#.#.#.#o#####.#.#.#.#o#o#........................
######.#.#.#.#.#.#.#.#.#.#.#.#o#.###.#.#.#.#.#.#o#o###.#.#.#.#o#o#o#.....................
#####.#.#.#.#.#.#.#.#.#.#.#.#######o#.#.#.#.#.#######.#.#.#.###.#o#.#.#.#.#.#............
######.#.#.#.#.#.#.#.#.#.#.#.#o#####.#.#.#.#.#.#o#####.#.#.#.#######.#.#.#.#.#.#.........
#####.#.#.#.#.#.#.#.#.#.#.#.###o###.#.#.#.#.#.###o#o#.#.#.#.#####o#.#.#.#.#.#.#.#.#..o#..
######.#.#.#.#.#.#.#.#.#.#.#.###o#.#.#.#.#.#.#.#######.#.#.#.###.###.#.#.#.#.#.#.#.######
#####.#.#.#.#.#.#.#.#.#.#.#.#########.#.#.#.#.#o#####.#.#.#.#######.#.#.#.#.#.#.#.#######
######.#.#.#.#.#.#.#.#.#.#.#.#.#o###.#.#.#.#.#.###o###.#.#.#.#.###o#.#.#.#.#.#.#.#.#o####
#####.#.#.#.#.#.#.#.#.#.#.#.###o#####.#.#.#.#.#####o#.#.#.#.#o###o#.#.#.#.#.#.#.#.#o#o###
######.#.#.#.#.#.#.#.#.#.#.#.#o#.###.#.#.#.#.#.#o###o#.#.#.#.#.#####.#.#.#.#.#.#.#.#o#o##
#####.#.#.#.#.#.#.#.#.#.#.#.#o#####o#.#.#.#.#.#####o#.#.#.#.#####o#.#.#.#.#.#.#.#.#######
##o###.#.#.#.#.#.#.#.#.#.#.#.#o#####.#.#.#.#.#.#######.#.#.#.#####o#.#.#.#.#.#.#.#.###o##
#####.#.#.#.#.#.#.#.#.#.#.#.#o#o#####.#.#.#.#.#####.#.#.#.#.###.###.#.#.#.#.#.#.#.#######
####o#.#.#.#.#.#.#.#.#.#.#.#.#######.#.#.#.#.#.###o###.#.#.#.#######.#.#.#.#.#.#.#.###o##
###.#.#.#.#.#.#.#.#.#.#.#.#.#o#o#o#o#.#.#.#.#.#######.#.#.#.#######.#.#.#.#.#.#.#.#######
##o#o#.#.#.#.#.#.#.#.#.#.#.#.###o###.#.#.#.#.#.#o#####.#.#.#.#######.#.#.#.#.#.#.#.#o####
###o#.#.#.#.#.#.#.#.#.#.#.#.#########.#.#.#.#.###o###.#.#.#.#o#####.#.#.#.#.#.#.#.###o###
##o###.#.#.#.#.#.#.#.#.#.#.#.#o#o###.#.#.#.#.#.#######.#.#.#.#o#####.#.#.#.#.#.#.#.######
#####.#.#.#.#.#.#.#.#.#.#.#.#o###o###.#.#.#.#.#######.#.#.#.#o#o#.#.#.#.#.#.#.#.#.###o###
##o###.#.#.#.#.#.#.#.#.#.#.#.#####o#.#.#.#.#.#.#o###o#.#.#.#.#o#o#o#.#.#.#.#.#.#.#.#o#o##
###o#.#.#.#.#.#.#.#.#.#.#.#.#o#o#o#o#.#.#.#.#.#######.#.#.#.###o###.#.#.#.#.#.#.#.#o#####
##o#o#.#.#.#.#.#.#.#.#.#.#.#.###o#o#.#.#.#.#.#.#######.#.#.#.###o###.#.#.#.#.#.#.#.###o##
###o#.#.#.#.#.#.#.#.#.#.#.#.###o###o#.#.#.#.#.#######.#.#.#.#o#o#o#.#.#.#.#.#.#.#.#o#o###
##o###.#.#.#.#.#.#.#.#.#.#.#.#o#o#o#.#.#.#.#.#.#.###.#.#.#.#.#o#####.#.#.#.#.#.#.#.######
###.#.#.#.#.#.#.#.#.#.#.#.#.#####o#o#.#.#.#.#.#######.#.#.#.###o###.#.#.#.#.#.#.#.#######
####o#.#.#.#.#.#.#.#.#.#.#.#.#.#o###.#.#.#.#.#.#o#####.#.#.#.#.#####.#.#.#.#.#.#.#.######
###.#.#o#o###o###o#o###o#.#####o#o#o#.###o###############.#o#####o###########o#######o###
##o###o#o#o#o#.#####o#############o###o#####################o#####o#o#######o#######o#o##
#########o#o#####o#.#o#####o#o#o#o#o#o#o#####o#############o#o#o#########################
##.#######o###o#o#o#o#####o#####o###o#o#.#o#o#######o###########.#######o#####o#o###o####
###########o###o###o#o#####o###o#o#o#o###o#o#####o#####o#####o#o###o###o#o#o#o#.###o#####
########o###o###o#o#.#o###########o###o###o#####o###o#######o###.#########o#####o###o####
###########o###o#####o#o###o#######o###o#o#o#####o###o#o###o#######o#.#o#########.#######
########o###.#o#o#o#o#####o#o#######o#o###.###o#o#######o#o#####.#.###o#o#####o#.########
###.#.###o#o#####o#o#o###o#####.###.#########o#o#.#############o###########o#####o#o#o###
##.#o#########o###.###.###o#####.#####o###o#o###o#o###############o#############o#.#o#.##
###o###.#o#o#o#o#o#o#o#o#o#o#####.#########o###########o#########o#####o#o###o###o#######""")
panel_21 = Panel("""........................................................................................
........................................................................................
........................................................................................
..........................#.............................................................
.......................#.#.#.#.#........................................................
....................#.#.#.#.#.#.#.......................................................
.................#.#.#.#.#.#.#.#.#.................................................#.###
..............#.#.#.#.#.#.#.#.#.#.#...............................................#.#.##
.............#.#.#.#.#.#.#.#.#.#.#.#.#.....................................#.#.#.#.#.###
..........#.#.#.#.#.#.#.#.#.#.#.#.#.#.#.#.................................#.#.#.#.#.#.##
.......#.#.#.#.#.#.#.#.#.#.#.#.#.#.#.#.#.#.............................#.#.#.#.#.#.#.###
..#.#.#.#.#.#.#.#.#.#.#.#.#.#.#.#.#.#.#.#.#.......................#.#.#.#.#.#.#.#.#.#.##
##.#.#.#.#.#.#.#.#.#.#.#.#.#.#.#.#.#.#.#.#.#.#.................#.#.#.#.#.#.#.#.#.#.#.###
###.#.#.#.#.#.#.#.#.#.#.#.#.#.#.#.#.#.#.#.#.#.#...............#.#.#.#.#.#.#.#.#.#.#.#.##
##.#.#.#.#.#.#.#.#.#.#.#.#.#.#.#.#.#.#.#.#.#.#.#.#.........#.#.#.#.#.#.#.#.#.#.#.#.#.###
###.#.#.#.#.#.#.#.#.#.#.#.#.#.#.#.#.#.#.#.#.#.#.#.#.#.#.#.#.#.#.#.#.#.#.#.#.#.#.#.#.#.##
##.#.#.#.#.#.#.#.#.#.#.#.#.#.#.#.#.#.#.#.#.#.#.#.#.#.#.#.#.#.#.#.#.#.#.#.#.#.#.#.#.#.###
###.#.#.#.#.#.#.#.#.#.#.#.#.#.#.#.#.#.#.#.#.#.#.#.#.#.#.#.#.#.#.#.#.#.#.#.#.#.#.#.#.#.##
##.#.#.#.#.#.#.#.#.#.#.#.#.#.#.#.#.#.#.#.#.#.#.#.#.#.#.#.#.#.#.#.#.#.#.#.#.#.#.#.#.#.###
###.#.#.#.#.#.#.#.#.#.#.#.#.#.#.#.#.#.#.#.#.#.#.#.#.#.#.#.#.#.#.#.#.#.#.#.#.#.#.#.#.#.##
##.#.#.#.#.#.#.#.#.#.#.#.#.#.#.#.#.#.#.#.#.#.#.#.#.#.#.#.#.#.#.#.#.#.#.#.#.#.#.#.#.#.###
###.#.#.#.#.#.#.#.#.#.#.#.#.#.#.#.#.#.#.#.#.#.#.#.#.#.#.#.#.#.#.#.#.#.#.#.#.#.#.#.#.#.##
##.#.#.#.#.#.#.#.#.#.#.#.#.#.#.#.#.#.#.#.#.#.#.#.#.#.#.#.#.#.#.#.#.#.#.#.#.#.#.#.#.#.###
###.#.#.#.#.#.#.#.#.#.#.#.#.#.#.#.#.#.#.#.#.#.#.#.#.#.#.#.#.#.#.#.#.#.#.#.#.#.#.#.#.#.##
##.#.#.#.#.#.#.#.#.#.#.#.#.#.#.#.#.#.#.#.#.#.#.#.#.#.#.#.#.#.#.#.#.#.#.#.#.#.#.#.#.#.###
###.#.#.#.#.#.#.#.#.#.#.#.#.#.#.#.#.#.#.#.#.#.#.#.#.#.#.#.#.#.#.#.#.#.#.#.#.#.#.#.#.#.##
##.#.#.#.#.#.#.#.#.#.#.#.#.#.#.#.#.#.#.#.#.#.#.#.#.#.#.#.#.#.#.#.#.#.#.#.#.#.#.#.#.#.###
###.#.#.#.#.#.#.#.#.#.#.#.#.#.#.#.#.#.#.#.#.#.#.#.#.#.#.#.#.#.#.#.#.#.#.#.#.#.#.#.#.#.##
##.#.#.#.#.#.#.#.#.#.#.#.#.#.#.#.#.#.#.#.#.#.#.#.#.#.#.#.#.#.#.#.#.#.#.#.#.#.#.#.#.#.###
###.#.#.#.#.#.#.#.#.#.#.#.#.#.#.#.#.#.#.#.#.#.#.#.#.#.#.#.#.#.#.#.#.#.#.#.#.#.#.#.#.#.##
##.#.#.#.#.#.#.#.#.#.#.#.#.#.#.#.#.#.#.#.#.#.#.#.#.#.#.#.#.#.#.#.#.#.#.#.#.#.#.#.#.#.###
###.#.#.#.#.#.#.#.#.#.#.#.#.#.#.#.#.#.#.#.#.#.#.#.#.#.#.#.#.#.#.#.#.#.#.#.#.#.#.#.#.#.##
##.#.#.#.#.#.#.#.#.#.#.#.#.#.#.#.#.#.#.#.#.#.#.#.#.#.#.#.#.#.#.#.#.#.#.#.#.#.#.#.#.#.###
###.#.#.#.#.#.#.#.#.#.#.#.#.#.#.#.#.#.#.#.#.#.#.#.#.#.#.#.#.#.#.#.#.#.#.#.#.#.#.#.#.#.##
##.#.#.#.#.#.#.#.#.#.#.#.#.#.#.#.#.#.#.#.#.#.#.#.#.#.#.#.#.#.#.#.#.#.#.#.#.#.#.#.#.#.###
###.#.#.#.#.#.#.#.#.#.#.#.#.#.#.#.#.#.#.#.#.#.#.#.#.#.#.#.#.#.#.#.#.#.#.#.#.#.#.#.#.#.##
##.#.#.#.#.#.#.#.#.#.#.#.#.#.#.#.#.#.#.#.#.#.#.#.#.#.#.#.#.#.#.#.#.#.#.#.#.#.#.#.#.#.###
###.#.#.#.#.#.#.#.#.#.#.#.#.#.#.#.#.#.#.#.#.#.#.#.#.#.#.#.#.#.#.#.#.#.#.#.#.#.#.#.#.#.##
##.#.#.#.#.#.#.#.#.#.#.#.#.#.#.#.#.#.#.#.#.#.#.#.#.#.#.#.#.#.#.#.#.#.#.#.#.#.#.#.#.#.###
#####o#.#############o#o#.#o#######.#.###########o#o#############o###o#####o#o#######o##
##o###o#######o###########o#o#o#o###################o#o#.#o#o#o###################o#####
#########################o###o###o#o###o#######.#####o#o#o#o#o###.###o#######o#o#o#o####""")
knots_8 = KnotPattern(Wall=rods_8.Wall, Pattern=panel_15, Turn=90, Push=-50)  # -> Wall, Sheet, Report
knots_9 = KnotPattern(Wall=rods_9.Wall, Pattern=panel_16, Turn=90, Push=-50)  # -> Wall, Sheet, Report
knots_10 = KnotPattern(Wall=rods_10.Wall, Pattern=panel_17, Turn=90, Push=-50)  # -> Wall, Sheet, Report
knots_11 = KnotPattern(Wall=rods_11.Wall, Pattern=panel_18, Turn=90, Push=-50)  # -> Wall, Sheet, Report
knots_12 = KnotPattern(Wall=rods_12.Wall, Pattern=panel_19, Turn=90, Push=-50)  # -> Wall, Sheet, Report
knots_13 = KnotPattern(Wall=rods_13.Wall, Pattern=panel_20, Turn=90, Push=-50)  # -> Wall, Sheet, Report
knots_14 = KnotPattern(Wall=rods_14.Wall, Pattern=panel_21, Turn=90, Push=-50)  # -> Wall, Sheet, Report
bout_8 = BrickOutputخروجیآجر(Wall=knots_8.Wall, Colour=1, Mortar=0)  # -> Bricks, Mesh, Problems, Warnings, Report, Legend, Mortar
panel_22 = Panel(knots_8.Report)
bout_9 = BrickOutputخروجیآجر(Wall=knots_9.Wall, Colour=1, Mortar=0)  # -> Bricks, Mesh, Problems, Warnings, Report, Legend, Mortar
panel_23 = Panel(knots_9.Report)
bout_10 = BrickOutputخروجیآجر(Wall=knots_10.Wall, Colour=1, Mortar=0)  # -> Bricks, Mesh, Problems, Warnings, Report, Legend, Mortar
panel_24 = Panel(knots_10.Report)
bout_11 = BrickOutputخروجیآجر(Wall=knots_11.Wall, Colour=1, Mortar=0)  # -> Bricks, Mesh, Problems, Warnings, Report, Legend, Mortar
panel_25 = Panel(knots_11.Report)
bout_12 = BrickOutputخروجیآجر(Wall=knots_12.Wall, Colour=1, Mortar=0)  # -> Bricks, Mesh, Problems, Warnings, Report, Legend, Mortar
panel_26 = Panel(knots_12.Report)
bout_13 = BrickOutputخروجیآجر(Wall=knots_13.Wall, Colour=1, Mortar=0)  # -> Bricks, Mesh, Problems, Warnings, Report, Legend, Mortar
panel_27 = Panel(knots_13.Report)
bout_14 = BrickOutputخروجیآجر(Wall=knots_14.Wall, Colour=1, Mortar=0)  # -> Bricks, Mesh, Problems, Warnings, Report, Legend, Mortar
panel_28 = Panel(knots_14.Report)
panel_29 = Panel(knots_11.Sheet)
