# Grasshopper definition inspired-by-40-knots.ghx (Grasshopper 1.0.8)
# Inspired by House of 40 Knots (Madjdabadi + Mashhadi Mirza, Tehran 2014). Bricks on rods; study, not the original design. Units: metres.

# Inspired by HOUSE OF 40 KNOTS
# Habibeh Madjdabadi + Alireza Mashhadi Mirza, Tehran, 2014
# 
# A study of the idea (bricks on rods, read out row by row like a carpet),
# not the original design. Units: metres.
pt = Point([Point(0, 0, 0), Point(5.1, 0, 0), Point(10.2, 0, 0)])
intcrv = Interpolate(Vertices=pt, Degree=3, Periodic=False, KnotStyle=0)  # -> Curve, Length, Domain
rods = RodScreen(Curve=intcrv.Curve, Height=15, Format="Iranian 20x10x5", Gap=15, Holes=1, Spacing=20, Rod=12)  # -> Wall, Rods, RodPipes, Report
fimg = FieldBitmapتصویر(Values=[0, 0, 0, 0, 0, 0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], Columns=34, Length=10.2, Height=15, Start=0, Bottom=0)
fimg_2 = FieldBitmapتصویر(Values=[0, 0, 0, 0, 0, 0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], Columns=34, Length=10.2, Height=15, Start=0, Bottom=0)
panel = Panel(rods.Report)
bop = BrickOperationعملیاتآجر(Wall=rods.Wall, Field=fimg, Mode=3, Amount=0.5, Steps=0)  # -> Wall, Variants
bop_2 = BrickOperationعملیاتآجر(Wall=bop.Wall, Field=fimg_2, Mode=0, Amount=90, Steps=1)  # -> Wall, Variants
bout = BrickOutputخروجیآجر(Wall=bop_2.Wall, Colour=0, Mortar=0)  # -> Bricks, Mesh, Problems, Warnings, Report, Legend, Mortar
panel_2 = Panel(bout.Report)
